# Grasshopper definition reinf_main.gh (Grasshopper 1.0.7)
# plug-ins: MeshEdit Components, Kangaroo2 Components

# ---- group: input problem
# VISUALS
max_dist = Slider(0.5, range=0..5)
# COMPUTATION
number_slider = Slider(0.3, range=0..5)
number_slider_2 = Slider(5, range=0..20)
number_slider_3 = Slider(5, range=0..20)
number_slider_4 = Slider(0.65, range=0..10)
number_slider_5 = Slider(0.05, range=0..10)
python = GhPythonScript(
    lx=number_slider_4,
    ly=Slider(0.65, range=0..10),
    lz=number_slider_5,
    nx=number_slider_2,
    ny=number_slider_3,
    nz=Slider(1, range=0..10),
    init_dist=number_slider,
    max_dist=max_dist)  # -> out, points, lines, start_idx, end_idx, supports, loads, init_set, comp_str, tens_str; inputs nx: Int32, ny: Int32, nz: Int32
# ---------- python: Python ----------
import rhinoscriptsyntax as rs
import itertools as it
from compas.datastructures import Network
from compas.geometry import distance_point_point

def filter_lines(u_xyz, v_xyz):
    ux, uy, uz = u_xyz
    vx, vy, vz = v_xyz
    if uy == vy and uz == vz and distance_point_point(u_xyz, v_xyz) > lx / nx + 1e-6:
        return False
    if ux == vx and uz == vz and distance_point_point(u_xyz, v_xyz) > ly / ny + 1e-6:
        return False
    return True    
    
# geometry

nodes = [[x * lx / max(1, nx), y * ly / max(1, ny), z * lz / max(1, nz)] for x, y, z in it.product(range(nx + 1), range(ny + 1), range(nz + 1))]
edges = [(u, v) for u, v in it.combinations(range(len(nodes)), 2) if distance_point_point(nodes[u], nodes[v]) < max_dist]
ntk = Network.from_nodes_and_edges(nodes, edges)

points = [rs.AddPoint(ntk.node_coordinates(key)) for key in ntk.nodes()]
#lines = [rs.AddLine(ntk.node_coordinates(u), ntk.node_coordinates(v)) for u, v in ntk.edges()]
lines = []
for u, v in ntk.edges():
    ux, uy, uz = ntk.node_coordinates(u)
    vx, vy, vz = ntk.node_coordinates(v)
    #if filter_lines(ntk.node_coordinates(u), ntk.node_coordinates(v)):
    lines.append(rs.AddLine([ux, uy, uz], [vx, vy, vz]))

# statics system

loads = []
supports = []
for key in ntk.nodes():
    x, y, z = ntk.node_coordinates(key)
    
    if ((abs(x) < 1e-6 and abs(y) < 1e-6) or (abs(x) < 1e-6 and abs(y - ly) < 1e-6) or (abs(x - lx) < 1e-6 and abs(y) < 1e-6) or (abs(x - lx) < 1e-6 and abs(y - ly) < 1e-6)) and z == 0:
    #if (y == 0 or y == ly) and z == 0:
    #if abs(y) < 1e-6 and (abs(x) < 1e-6 or abs(x - lx / 2) < 1e-6 or abs(x - lx) < 1e-6):
        supports.append(rs.AddPoint([1, 1, 0]))
    else:
        supports.append(rs.AddPoint([1, 1, 1]))
    if abs(z - lz) < 1e-6:
        loads.append(rs.AddPoint([0.0, 0.0, -0.001  / len(nodes)]))
    else:
        loads.append(rs.AddPoint([0.0, 0.0, 0.0]))

# line attributes

start_idx, end_idx = [], [] # extremity vertices
init_set = [] # is line include in initial set for optimisation
comp_str = [] # compressive strength
tens_str = [] # tensile strength
for u, v in ntk.edges():
    ux, uy, uz = ntk.node_coordinates(u)
    vx, vy, vz = ntk.node_coordinates(v)
    if filter_lines(ntk.node_coordinates(u), ntk.node_coordinates(v)):
    
        start_idx.append(u)
        end_idx.append(v)
        
        if ntk.edge_length(u, v) < init_dist:
            init_set.append(True)
        else:
            init_set.append(False)
        
        comp_str.append(1.0)
        
        #tens_str.append(1.0)
        
        if uz == vz or (ux == vx and uy == vy):
            tens_str.append(1.0)
        else:
            tens_str.append(0.0)
# ---------- end python ----------

# ---- group: plot system
# RESULTS
panel = Panel("1")
rev = Reverse(Vector=python.supports)
vec = VectorXYZ(XComponent=panel, YComponent=panel, ZComponent=panel)  # -> Vector, Length
addition = Addition(A=vec.Vector, B=rev)
line = Line(python.lines)
multiplication = Multiplication(A=addition, B=Slider(0.1, range=0..0.1))
len = Length(Curve=line)
rev_2 = Reverse(Vector=python.loads)
smaller = SmallerThan(FirstNumber=len, SecondNumber=max_dist)  # -> SmallerThan, OrEqualTo
rev_3 = Reverse(Vector=multiplication)
move = Move(Geometry=python.points, Motion=rev_2)  # -> Geometry, Transform
dispatch = Dispatch(List=line, DispatchPattern=smaller.SmallerThan)  # -> ListA, ListB
move_2 = Move(Geometry=python.points, Motion=rev_3)  # -> Geometry, Transform
vdis = VectorDisplay(Anchor=move.Geometry, Vector=python.loads)
preview = CustomPreview(Geometry=dispatch.ListA, Material=ColourSwatch(SwatchColor=RGB(127, 127, 127)))
vdis_2 = VectorDisplay(Anchor=move_2.Geometry, Vector=multiplication)

# ---- group: optimisation
python_2 = GhPythonScript(
    points=python.points,
    supports=python.supports,
    loads=python.loads,
    start_point_indices=python.start_idx,
    end_point_indices=python.end_idx,
    compressive_strengths=python.comp_str,
    tensile_strengths=python.tens_str,
    in_initial_set=python.init_set)  # -> out, lines, sections, forces; inputs points: list, supports: list, loads: list, start_point_indices: list of Int32, end_point_indices: list of Int32, compressive_strengths: list, tensile_strengths: list, in_initial_set: list of Boolean
# ---------- python_2: Python ----------
import rhinoscriptsyntax as rs
import itertools as it
#from compas.rpc import Proxy
from compas_cloud import Proxy
import acorn_reinforcement

# constrained layout optimisation

#proxy = Proxy("acorn_reinforcement.optimisation")
#proxy.restart_server()
#lo2 = proxy.lo2
proxy = Proxy()
lo2 = proxy.function("acorn_reinforcement.optimisation.lo2")

nodes = [([xyz for xyz in rs.PointCoordinates(point)], [xyz for xyz in rs.PointCoordinates(support)], [xyz for xyz in rs.PointCoordinates(load)]) for point, support, load in zip(points, supports, loads)]
lines = [(i, j, cs, ts, include) for i, j, cs, ts, include in zip(start_point_indices, end_point_indices, compressive_strengths, tensile_strengths, in_initial_set)]

Nd, Cn, a, q = lo2(nodes, lines, joint_cost=.0001)

threshold = 1e-6
lines = [rs.AddLine(Nd[int(cn[0])], Nd[int(cn[1])]) for i, cn in enumerate(Cn) if a[i] > threshold]
sections = [ai for ai in a if ai > threshold]
forces = [qi for i, qi in enumerate(q[0]) if a[i] > threshold]
# ---------- end python_2 ----------

# ---- group: struts and ties
multiplication_2 = Multiplication(A=number_slider_4, B="1.5")
python_3 = GhPythonScript(lines=python_2.lines, sections=python_2.sections, forces=python_2.forces, threshold="1e-6")  # -> out, struts, ties; inputs lines: list, sections: list, forces: list
# ---------- python_3: Python ----------
import rhinoscriptsyntax as rs
from math import pi

# get compressive struts and tensile ties

struts, ties = [], []
for line, section, force in zip(lines, sections, forces):
    if abs(force) > threshold:
        pipe = rs.AddPipe(line, 0, (section / pi) ** .5, blend_type=1, cap=1, fit=False)
        if force > 0:
            ties += pipe
        else:
            struts += pipe
# ---------- end python_3 ----------
X = UnitX(Factor=multiplication_2)
move_3 = Move(Geometry=python_3.ties, Motion=X)  # -> Geometry, Transform
move_4 = Move(Geometry=python_3.struts, Motion=X)  # -> Geometry, Transform
preview_2 = CustomPreview(Geometry=move_4.Geometry, Material=ColourSwatch(SwatchColor=RGB(0, 0, 255)))
preview_3 = CustomPreview(Geometry=move_3.Geometry, Material=ColourSwatch(SwatchColor=RGB(255, 0, 0)))

# ----
devec = DeconstructVector(Vector=python.loads)  # -> XComponent, YComponent, ZComponent
abs = Absolute(Value=python_2.forces)
len_2 = Length(Curve=python_2.lines)

# ---- group: element sizing
filament_axial_strength_mpa = Panel("50")
filament_cross_section_area_m2 = Panel("0.000000001")
panel_2 = Panel("0")
python_4 = GhPythonScript(lines=python_2.lines, forces=python_2.forces, threshold="1e-6")  # -> out, vert_reinf_lines, vert_reinf_forces; inputs lines: list, forces: list
# ---------- python_4: Python ----------
import rhinoscriptsyntax as rs

# get the vertical tensile lines and forces

vert_reinf_lines, vert_reinf_forces = [], []
for line, force in zip(lines, forces):
    if force > threshold:
        ax, ay, az = rs.CurveStartPoint(line)
        bx, by, bz = rs.CurveEndPoint(line)
        if ax == bx and ay == by:
            vert_reinf_lines.append(line)
            vert_reinf_forces.append(force)
# ---------- end python_4 ----------
python_5 = GhPythonScript(
    lines=python_2.lines,
    forces=python_2.forces,
    threshold="1e-12",
    zmin=panel_2,
    zmax=number_slider_5,
    fil_str=filament_axial_strength_mpa,
    fil_sec=filament_cross_section_area_m2)  # -> out, bottom_reinf, top_reinf; inputs lines: list, forces: list
# ---------- python_5: Python ----------
import rhinoscriptsyntax as rs
from math import ceil

# get the reinforcement at the top and the bottom surfaces
# sized by filament strength in MPa and cross-section in m2

bottom_reinf, top_reinf = [], []
all_bottom_lines, all_top_lines = [], []
for line, force in zip(lines, forces):
    if force > threshold:
        ax, ay, az = rs.CurveStartPoint(line)
        bx, by, bz = rs.CurveEndPoint(line)
        n = int(ceil(force / (fil_str * fil_sec * 1000)))
        if az == zmin and bz == zmin:
            bottom_reinf += [line] * n
        elif az == zmax and bz == zmax:
            top_reinf += [line] * n
# ---------- end python_5 ----------

# ----
multiplication_3 = Multiplication(A=len_2, B=abs)
ma = MassAddition(Input=devec.ZComponent)  # -> Result, PartialResults
ma_2 = MassAddition(Input=multiplication_3)  # -> Result, PartialResults
total_load = Panel(ma.Result)
python_6 = GhPythonScript(lines=python.lines, zmin=panel_2, zmax=number_slider_5)  # -> out, all_bottom_lines, all_top_lines; inputs lines: list
# ---------- python_6: Python ----------
import rhinoscriptsyntax as rs

all_bottom_lines, all_top_lines = [], []
for line in lines:
    ax, ay, az = rs.CurveStartPoint(line)
    bx, by, bz = rs.CurveEndPoint(line)
    if az == zmin and bz == zmin:
        all_bottom_lines.append(line)
    elif az == zmax and bz == zmax:
        all_top_lines.append(line)
# ---------- end python_6 ----------
load_path = Panel(ma_2.Result)

pt = Point(python.points)
pdecon = Deconstruct(Point=pt)  # -> XComponent, YComponent, ZComponent
equals = Equality(FirstNumber=pdecon.ZComponent, SecondNumber="0")  # -> Equality, Inequality
dispatch_2 = Dispatch(List=pt, DispatchPattern=equals.Equality)  # -> ListA, ListB
addition_2 = Addition(A=number_slider_3, B=1)
addition_3 = Addition(A=number_slider_2, B=1)
frompoints = MeshFromPoints(Points=dispatch_2.ListA, UDirection=addition_3, VDirection=addition_2)
python_7 = GhPythonScript(mesh=frompoints, u0=Slider(25, range=0..100), v0=Slider(14, range=0..100))  # -> out, a, b
# ---------- python_7: Python ----------
import rhinoscriptsyntax as rs
from compas.datastructures import Mesh, Network, network_polylines
from compas.geometry import intersection_segment_segment, is_point_on_line, distance_point_point
from compas.utilities import geometric_key, pairwise
    
vertices = rs.MeshVertices(mesh)
faces = rs.MeshFaceVertices(mesh)
mesh = Mesh.from_vertices_and_faces(vertices, faces)
geomap = {geometric_key(mesh.vertex_coordinates(vkey)): vkey for vkey in mesh.vertices()}

line0 = (mesh.vertex_coordinates(u0), mesh.vertex_coordinates(v0))

# split at intersection with vertices
splits = {}
for vkey in mesh.vertices():
    xyz = mesh.vertex_coordinates(vkey)
    if is_point_on_line(xyz, line0):
        splits[tuple(xyz)] = distance_point_point(xyz, line0[0])
lines0 = [(u[0], v[0]) for u, v in pairwise(sorted(splits.items(), key=lambda item: item[1]))]

# follow dual-edge path
a, b = [], []
for line0 in lines0:

    # get intersections with edges
    edges = []
    dual_edges = []
    for u, v in mesh.edges():
        line = mesh.edge_coordinates(u, v)
        i = intersection_segment_segment(line0, line)
        if i != (None, None):
            if distance_point_point(i[0], line[0]) > 1e-6 and distance_point_point(i[0], line[1]) > 1e-6:
                if not mesh.is_edge_on_boundary(u, v):
                    f0, f1 = mesh.halfedge[u][v], mesh.halfedge[v][u]
                    edges.append((u, v))
                    dual_edges.append((f0, f1))

    # create polyline
    dual_lines = [rs.AddLine(mesh.face_centroid(f0), mesh.face_centroid(f1)) for f0, f1 in dual_edges]
    dual_nodes = [mesh.face_centroid(fkey) for fkey in mesh.faces()]
    nwk = Network.from_nodes_and_edges(dual_nodes, dual_edges)
    extremities = [node for node in nwk.nodes() if nwk.is_leaf(node)]
    if len(extremities) == 2:
        dual_path = nwk.shortest_path(*extremities)
        # check orientation
        if distance_point_point(mesh.face_centroid(dual_path[0]), line0[0]) > distance_point_point(mesh.face_centroid(dual_path[0]), line0[-1]):
            dual_path.reverse()
        # check relevance of first edge
        if geomap[geometric_key(line0[0])] in mesh.face_vertices(dual_path[1]):
            del dual_path[0]
        # check relevance of last edge
        if geomap[geometric_key(line0[-1] )]in mesh.face_vertices(dual_path[-2]):
            del dual_path[-1]
        # form polyline
        polyline = [mesh.face_centroid(fkey)for fkey in dual_path]
        polyline.insert(0, line0[0])
        polyline.append(line0[-1])
        a.append(rs.AddPolyline(polyline))
        b.append(rs.AddLine(*line0))
    else:
        print('!')
# ---------- end python_7 ----------
geo = Geometry(python_7.a)
geo_2 = Geometry(python_7.b)
fillet = Fillet(Curve=geo, Radius=".2")

# ---- group: split (move upstream)
python_8 = GhPythonScript(lines=python_5.bottom_reinf, mesh=frompoints)  # -> out, split_lines; inputs lines: list
# ---------- python_8: Python ----------
import rhinoscriptsyntax as rs
from compas.datastructures import Mesh
from compas.utilities import pairwise
from compas.geometry import is_point_on_segment, distance_point_point

lines = [(rs.CurveStartPoint(line), rs.CurveEndPoint(line)) for line in lines]
mesh = Mesh.from_vertices_and_faces(rs.MeshVertices(mesh), rs.MeshFaceVertices(mesh))

split_lines = []
for line in lines:
    splits = {}
    for vkey in mesh.vertices():
        xyz = mesh.vertex_coordinates(vkey)
        if is_point_on_segment(xyz, line):
            splits[tuple(xyz)] = distance_point_point(xyz, line[0])
    split_lines += [(a[0], b[0]) for a, b in pairwise(sorted(splits.items(), key=lambda item: item[1]))]

split_lines = [rs.AddLine(*line) for line in split_lines]
# ---------- end python_8 ----------
python_9 = GhPythonScript(lines=python_6.all_bottom_lines, mesh=frompoints)  # -> out, split_lines; inputs lines: list; same code as python_8

# ----
pt_2 = Point(dispatch_2.ListA)
panel_3 = Panel(""".05
.95""")

# ---- group: eulerisation
python_10 = GhPythonScript(required_lines=python_8.split_lines, optional_lines=python_9.split_lines)  # -> out, polyline; inputs required_lines: list, optional_lines: list
# ---------- python_10: Python ----------
import rhinoscriptsyntax as rs
import itertools as it
from compas_cloud import Proxy
import acorn_reinforcement
from compas.utilities import geometric_key

# eulerisation to find a continuous through the lines

proxy = Proxy()
#proxy.restart()
rpp = proxy.function("acorn_reinforcement.eulerisation.rpp")

required_lines = required_lines or []
optional_lines = optional_lines or []

count = 0
geom_keys = {}
for line in required_lines + optional_lines:
    for point in (rs.CurveStartPoint(line), rs.CurveEndPoint(line)):
        point = [xyz for xyz in point]
        if geometric_key(point) not in geom_keys:
            geom_keys[geometric_key(point)] = (point, count)
            count += 1

key_to_xyz ={key: xyz for xyz, key in geom_keys.values()} 

required_lines = [(geom_keys[geometric_key(rs.CurveStartPoint(line))][1], geom_keys[geometric_key(rs.CurveEndPoint(line))][1]) for line in required_lines]
optional_lines = [(geom_keys[geometric_key(rs.CurveStartPoint(line))][1], geom_keys[geometric_key(rs.CurveEndPoint(line))][1]) for line in optional_lines]

edges = rpp(required_lines, optional_lines, key_to_xyz)

if len(edges) != 0:
    polyline = rs.AddPolyline([key_to_xyz[edges[0][0]]] + [key_to_xyz[edge[1]] for edge in edges])
else:
    polyline = None
# ---------- end python_10 ----------

# ---- group: plot passes
python_11 = GhPythonScript(polyline=python_10.polyline)  # -> out, unique_lines, counts; inputs polyline: list
# ---------- python_11: Python ----------
import rhinoscriptsyntax as rs
from compas.utilities import geometric_key, reverse_geometric_key

# count passes per line

lines = rs.ExplodeCurves(polyline)

line_count = {}
for line in lines:
    u_gk = geometric_key(rs.CurveStartPoint(line))
    v_gk = geometric_key(rs.CurveEndPoint(line))
    if (u_gk, v_gk) in line_count:
        line_count[(u_gk, v_gk)] += 1
    elif (v_gk, u_gk) in line_count:
        line_count[(v_gk, u_gk)] += 1
    else:
        line_count[(u_gk, v_gk)] = 1

unique_lines = []
counts = []
for (u_gk, v_gk), count in line_count.items():
    u_xyz = reverse_geometric_key(u_gk)
    v_xyz = reverse_geometric_key(v_gk)
    unique_lines.append(rs.AddLine(u_xyz, v_xyz))
    counts.append(count)
# ---------- end python_11 ----------
sort = SortList(Keys=python_11.counts)  # -> Keys, ValuesA
item = ListItem(List=reverse(sort.Keys), Index=0, Wrap=True)
item_2 = ListItem(List=sort.Keys, Index=0, Wrap=True)
gradient = Gradient(
    LowerLimit=item_2,
    UpperLimit=item,
    Parameter=python_11.counts,
    stops=[0: RGB(0, 128, 0), 0.5: RGB(255, 255, 0), 1: RGB(255, 0, 0)])
multiplication_4 = Multiplication(A=python_11.counts, B=Slider(0.001, range=0..0.01))
multiplication_5 = Multiplication(A=X, B="2")
move_5 = Move(Geometry=python_11.unique_lines, Motion=multiplication_5)  # -> Geometry, Transform
pipe = Pipe(Curve=move_5.Geometry, Radius=multiplication_4, Caps=2)  # -> flatten(Pipe); disabled
preview_4 = CustomPreview(Geometry=move_5.Geometry, Material=gradient)

# ----
explode = Explode(Curve=python_10.polyline, Recursive=True)  # -> Segments, Vertices
shatter = Shatter(Curve=reparameterize(explode.Segments), Parameters=panel_3)
item_3 = ListItem(List=shatter, Index="1", Wrap=True)
geo_3 = Geometry(item_3)

# ---- group: wound path
# strictly higer than 2!
number_slider_6 = Slider(0.005, range=0..0.01)
lx = Expression(lx=number_slider_4, nx=number_slider_2, k="3", Expression="lx / nx / k")
python_12 = GhPythonScript(polyline=python_10.polyline, h_offset=lx, v_offset=number_slider_6)  # -> out, total_path
# ---------- python_12: Python ----------
from math import pi
import rhinoscriptsyntax as rs
from acorn_reinforcement.winding import wind_polyline
from compas.utilities import geometric_key, pairwise, window
from compas.geometry import length_vector, add_vectors, subtract_vectors, scale_vector, normalize_vector, centroid_points, centroid_points_weighted, angle_points, angle_vectors, cross_vectors, dot_vectors, rotate_points, midpoint_point_point

### horizontal offset of the polyline ###

vertices = rs.PolylineVertices(polyline)

wound_lines = wind_polyline(vertices, h_offset)

# mark if path is straight to simplify path later
is_path_straight = [False] + [b == c for (a, b), (c, d) in pairwise(wound_lines)] + [False]

### vertical offset at the nodes ###

points = {}
for vertex in vertices:
    gkey = geometric_key(vertex)
    if gkey not in points:
        points[gkey] = -1

offset_nb = []
for vertex in vertices:
    gkey = geometric_key(vertex)
    points[gkey] += 1
    offset_nb.append(points[gkey])

top_offset = max(offset_nb) + 1
offset_vect = [0.0, 0.0, v_offset]
offset_vertices = [add_vectors(vertex, scale_vector(offset_vect, offset_nb[i])) for i, vertex in enumerate(vertices)]

# differentiated vertical offset of the polyline lines and sublines

offset_wound_lines = []
for i, (a, f) in enumerate(wound_lines):
    # create polylines (a, b, c, d, e, f) with three horizontal lines and two vertical lines like a crenel
    af = normalize_vector(subtract_vectors(f, a))
    af_start = scale_vector(af, h_offset)
    af_end = af_1 = scale_vector(af_start, -1)
    b = add_vectors(a, af_start)
    e = add_vectors(f, af_end)
    #if not is_point_in_box_xy(midpoint_point_point(a, f), xmin, xmax, ymin, ymax):
    #    local_top_offset = max(offset_nb[i], offset_nb[i + 1])
    #    c = add_vectors(b, scale_vector(offset_vect, local_top_offset))
    #    d = add_vectors(e, scale_vector(offset_vect, local_top_offset))
    c = add_vectors(b, scale_vector(offset_vect, top_offset))
    d = add_vectors(e, scale_vector(offset_vect, top_offset))
    a = add_vectors(a, scale_vector(offset_vect, offset_nb[i]))
    a0 = add_vectors(a, scale_vector(offset_vect, top_offset))
    b = add_vectors(b, scale_vector(offset_vect, offset_nb[i]))
    e = add_vectors(e, scale_vector(offset_vect, offset_nb[i + 1]))
    f = add_vectors(f, scale_vector(offset_vect, offset_nb[i + 1]))
    f0 = add_vectors(f, scale_vector(offset_vect, top_offset))
    straight_start, straight_end = is_path_straight[i], is_path_straight[i + 1]
    if not straight_start and not straight_end:
        offset_wound_lines.append([a, b, c, d, e, f])
    elif straight_start and not straight_end:
        offset_wound_lines.append([a0, d, e, f])
    elif not straight_start and straight_end:
        offset_wound_lines.append([a, b, c, f0])
    else:
        offset_wound_lines.append([a0, f0])

# complete total path with arc elements around nodes between lines

total_path = []

for i, vertex in enumerate(offset_vertices[1:-1]):
    prev_line, next_line = offset_wound_lines[i : i + 2]
    prev_pt, next_pt = prev_line[-1], next_line[0]
    
    # initial loop to lock
    if i == 0:
        a = prev_line[0]
        centre = [vertices[0][0], vertices[0][1], a[2]]
        direction = normalize_vector(subtract_vectors(prev_line[0], prev_line[1]))
        b = add_vectors(centre, scale_vector(direction, h_offset))
        c = add_vectors(centre, subtract_vectors(centre, a))
        total_path.append(rs.AddArc3Pt(a, c, b))
    
    total_path.append(rs.AddPolyline(prev_line))
    
    # connect with arcs
    if geometric_key(prev_pt) != geometric_key(next_pt):
        mid_pt = centroid_points([prev_pt, next_pt])
        prev_dir = normalize_vector(subtract_vectors(prev_line[-1], prev_line[-2]))
        next_dir = normalize_vector(subtract_vectors(next_line[1], next_line[0]))
        dir = normalize_vector(add_vectors(prev_dir, scale_vector(next_dir, -1)))
        arc_pt = add_vectors(scale_vector(dir, h_offset), vertex)
        total_path.append(rs.AddArc3Pt(prev_pt, next_pt, arc_pt))
    
    if i == len(offset_vertices[1:-1]) - 1:
        total_path.append(rs.AddPolyline(next_line))
        # final loop to lock
        a = next_line[-1]
        centre = [vertices[-1][0], vertices[-1][1], a[2]]
        direction = normalize_vector(subtract_vectors(next_line[-1], next_line[-2]))
        b = add_vectors(centre, scale_vector(direction, h_offset))
        c = add_vectors(centre, subtract_vectors(centre, a))
        total_path.append(rs.AddArc3Pt(a, c, b))
# ---------- end python_12 ----------

# ----
explode_2 = Explode(Curve=python_10.polyline, Recursive=True)  # -> Segments, Vertices
python_13 = GhPythonScript(mesh=frompoints, polyline=python_10.polyline, h_offset=lx, v_offset=number_slider_6)  # -> out, total_path, zz; disabled
# ---------- python_13: Python ----------
from math import pi
import rhinoscriptsyntax as rs
from compas.datastructures import Mesh, Network, network_polylines
from acorn_reinforcement.winding import wind_polyline
from compas.utilities import geometric_key, pairwise, window
from compas.geometry import length_vector, add_vectors, subtract_vectors, scale_vector, normalize_vector
from compas.geometry import centroid_points, centroid_points_weighted
from compas.geometry import angle_points, angle_vectors, cross_vectors, dot_vectors, rotate_points, midpoint_point_point
from compas.geometry import intersection_segment_segment, is_point_on_line, distance_point_point

### refine polyline ###

vertices = rs.MeshVertices(mesh)
faces = rs.MeshFaceVertices(mesh)
mesh = Mesh.from_vertices_and_faces(vertices, faces)
geomap = {geometric_key(mesh.vertex_coordinates(vkey)): vkey for vkey in mesh.vertices()}

polyline = rs.PolylineVertices(polyline)

# split polyline at intersection with vertices
new_polyline = []
for i, line in enumerate(pairwise(polyline)):
    splits = {}
    for vkey in mesh.vertices():
        xyz = mesh.vertex_coordinates(vkey)
        if is_point_on_line(xyz, line):
            splits[tuple(xyz)] = distance_point_point(xyz, line[0])
    sorted_keys = [items[0] for items in sorted(splits.items(), key=lambda item: item[1])]
    if i == 0:
        new_polyline += sorted_keys
    else:
        new_polyline += sorted_keys[:-1]
    

#    # follow dual-edge path
#    for line0 in lines0:

#        # get intersections with edges
 #       edges = []
  #      dual_edges = []
   #     for u, v in mesh.edges():
    #        line = mesh.edge_coordinates(u, v)
     #       i = intersection_segment_segment(line0, line)
      #      if i != (None, None):
       #         if distance_point_point(i[0], line[0]) > 1e-6 and distance_point_point(i[0], line[1]) > 1e-6:
        #            if not mesh.is_edge_on_boundary(u, v):
         #               f0, f1 = mesh.halfedge[u][v], mesh.halfedge[v][u]
          #              edges.append((u, v))
           #             dual_edges.append((f0, f1))

        # create polyline
#        dual_lines = [rs.AddLine(mesh.face_centroid(f0), mesh.face_centroid(f1)) for f0, f1 in dual_edges]
 #       dual_nodes = [mesh.face_centroid(fkey) for fkey in mesh.faces()]
  #      nwk = Network.from_nodes_and_edges(dual_nodes, dual_edges)
   #     extremities = [node for node in nwk.nodes() if nwk.is_leaf(node)]
    #    if len(extremities) == 2:
     #       #print('!')
      #      dual_path = nwk.shortest_path(*extremities)
       #     # check orientation
        #    if distance_point_point(mesh.face_centroid(dual_path[0]), line0[0]) > distance_point_point(mesh.face_centroid(dual_path[0]), line0[-1]):
         #       dual_path.reverse()
            # check relevance of first edge
#            if geomap[geometric_key(line0[0])] in mesh.face_vertices(dual_path[1]):
 #               del dual_path[0]
            # check relevance of last edge
  #          if geomap[geometric_key(line0[-1] )]in mesh.face_vertices(dual_path[-2]):
   #             del dual_path[-1]
            # form polyline
    #        pl = [mesh.face_centroid(fkey)for fkey in dual_path]
     #       pl.insert(0, line0[0])
      #      pl.append(line0[-1])
       #     new_polyline.append(pl)

   #     else:
    #        new_polyline.append([line0[0], midpoint_point_point(*line0) ,line0[1]])
print(new_polyline)
zz = rs.AddPolyline(new_polyline)

### horizontal offset of the polyline ###


wound_lines = wind_polyline(new_polyline, h_offset)

#new_wound_lines = []
## insert
#for i, line in enumerate(wound_lines):
#    pl = new_polyline[i]
#    new_pl = list(line[:1]) + list(pl[1:-1]) + list(line[-1:])
#    if len(new_pl) > 2:
#        new_wound_lines.append(rs.AddPolyline(new_pl))
#    else:
#        new_wound_lines.append(rs.AddLine(*new_pl))

# mark if path is straight to simplify path later
is_path_straight = [False] + [b == c for (a, b), (c, d) in pairwise(wound_lines)] + [False]

### vertical offset at the nodes ###

points = {}
for vertex in new_polyline:
    gkey = geometric_key(vertex)
    if gkey not in points:
        points[gkey] = -1

offset_nb = []
for vertex in new_polyline:
    gkey = geometric_key(vertex)
    points[gkey] += 1
    offset_nb.append(points[gkey])

top_offset = max(offset_nb) + 1
offset_vect = [0.0, 0.0, v_offset]
offset_vertices = [add_vectors(vertex, scale_vector(offset_vect, offset_nb[i])) for i, vertex in enumerate(new_polyline)]

# differentiated vertical offset of the polyline lines and sublines

offset_wound_lines = []
for i, (a, f) in enumerate(wound_lines):
    # create polylines (a, b, c, d, e, f) with three horizontal lines and two vertical lines like a crenel
    af = normalize_vector(subtract_vectors(f, a))
    af_start = scale_vector(af, h_offset)
    af_end = af_1 = scale_vector(af_start, -1)
    b = add_vectors(a, af_start)
    e = add_vectors(f, af_end)
    #if not is_point_in_box_xy(midpoint_point_point(a, f), xmin, xmax, ymin, ymax):
    #    local_top_offset = max(offset_nb[i], offset_nb[i + 1])
    #    c = add_vectors(b, scale_vector(offset_vect, local_top_offset))
    #    d = add_vectors(e, scale_vector(offset_vect, local_top_offset))
    c = add_vectors(b, scale_vector(offset_vect, top_offset))
    d = add_vectors(e, scale_vector(offset_vect, top_offset))
    a = add_vectors(a, scale_vector(offset_vect, offset_nb[i]))
    a0 = add_vectors(a, scale_vector(offset_vect, top_offset))
    b = add_vectors(b, scale_vector(offset_vect, offset_nb[i]))
    e = add_vectors(e, scale_vector(offset_vect, offset_nb[i + 1]))
    f = add_vectors(f, scale_vector(offset_vect, offset_nb[i + 1]))
    f0 = add_vectors(f, scale_vector(offset_vect, top_offset))
    straight_start, straight_end = is_path_straight[i], is_path_straight[i + 1]
    if not straight_start and not straight_end:
        offset_wound_lines.append([a, b, c, d, e, f])
    elif straight_start and not straight_end:
        offset_wound_lines.append([a0, d, e, f])
    elif not straight_start and straight_end:
        offset_wound_lines.append([a, b, c, f0])
    else:
        offset_wound_lines.append([a0, f0])

# complete total path with arc elements around nodes between lines

total_path = []

for i, vertex in enumerate(offset_vertices[1:-1]):
    prev_line, next_line = offset_wound_lines[i : i + 2]
    prev_pt, next_pt = prev_line[-1], next_line[0]
    
    # initial loop to lock
    if i == 0:
        a = prev_line[0]
        centre = [new_polyline[0][0], new_polyline[0][1], a[2]]
        direction = normalize_vector(subtract_vectors(prev_line[0], prev_line[1]))
        b = add_vectors(centre, scale_vector(direction, h_offset))
        c = add_vectors(centre, subtract_vectors(centre, a))
        total_path.append(rs.AddArc3Pt(a, c, b))
    
    total_path.append(rs.AddPolyline(prev_line))
    
    # connect with arcs
    if geometric_key(prev_pt) != geometric_key(next_pt):
        mid_pt = centroid_points([prev_pt, next_pt])
        prev_dir = normalize_vector(subtract_vectors(prev_line[-1], prev_line[-2]))
        next_dir = normalize_vector(subtract_vectors(next_line[1], next_line[0]))
        dir = normalize_vector(add_vectors(prev_dir, scale_vector(next_dir, -1)))
        arc_pt = add_vectors(scale_vector(dir, h_offset), vertex)
        total_path.append(rs.AddArc3Pt(prev_pt, next_pt, arc_pt))
    
    if i == len(offset_vertices[1:-1]) - 1:
        total_path.append(rs.AddPolyline(next_line))
        # final loop to lock
        a = next_line[-1]
        centre = [new_polyline[-1][0], new_polyline[-1][1], a[2]]
        direction = normalize_vector(subtract_vectors(next_line[-1], next_line[-2]))
        b = add_vectors(centre, scale_vector(direction, h_offset))
        c = add_vectors(centre, subtract_vectors(centre, a))
        total_path.append(rs.AddArc3Pt(a, c, b))
# ---------- end python_13 ----------
python_14 = GhPythonScript(polyline=python_10.polyline, mesh=frompoints, h_offset=lx, v_offset=number_slider_6)  # -> out, total_path, zzz
# ---------- python_14: Python ----------
from math import pi
import rhinoscriptsyntax as rs
from acorn_reinforcement.winding import wind_polyline
from compas.datastructures import Mesh, Network
from compas.utilities import geometric_key, pairwise, window
from compas.geometry import length_vector, add_vectors, subtract_vectors, scale_vector, normalize_vector, centroid_points, centroid_points_weighted, angle_points, angle_vectors, cross_vectors, dot_vectors, rotate_points, distance_point_point, midpoint_point_point, intersection_segment_segment

### horizontal offset of the polyline ###

vertices = rs.PolylineVertices(polyline)
mesh = Mesh.from_vertices_and_faces(rs.MeshVertices(mesh), rs.MeshFaceVertices(mesh))
geomap = {geometric_key(mesh.vertex_coordinates(vkey)): vkey for vkey in mesh.vertices()}

wound_lines = wind_polyline(vertices, h_offset)

# mark if path is straight to simplify path later
is_path_straight = [False] + [b == c for (a, b), (c, d) in pairwise(wound_lines)] + [False]


###
zz = []
for line0 in pairwise(vertices):
    # get intersections with edges
    edges = []
    dual_edges = []
    for u, v in mesh.edges():
        line = mesh.edge_coordinates(u, v)
        i = intersection_segment_segment(line0, line)
        if i != (None, None):
            if distance_point_point(i[0], line[0]) > 1e-6 and distance_point_point(i[0], line[1]) > 1e-6:
                if not mesh.is_edge_on_boundary(u, v):
                    f0, f1 = mesh.halfedge[u][v], mesh.halfedge[v][u]
                    edges.append((u, v))
                    dual_edges.append((f0, f1))

    # create polyline
    dual_lines = [rs.AddLine(mesh.face_centroid(f0), mesh.face_centroid(f1)) for f0, f1 in dual_edges]
    dual_nodes = [mesh.face_centroid(fkey) for fkey in mesh.faces()]
    nwk = Network.from_nodes_and_edges(dual_nodes, dual_edges)
    extremities = [node for node in nwk.nodes() if nwk.is_leaf(node)]
    if len(extremities) == 2:
        dual_path = nwk.shortest_path(*extremities)
        # check orientation
        if distance_point_point(mesh.face_centroid(dual_path[0]), line0[0]) > distance_point_point(mesh.face_centroid(dual_path[0]), line0[-1]):
            dual_path.reverse()
        # check relevance of first edge
        if geomap[geometric_key(line0[0])] in mesh.face_vertices(dual_path[1]):
            del dual_path[0]
        # check relevance of last edge
        if geomap[geometric_key(line0[-1] )]in mesh.face_vertices(dual_path[-2]):
            del dual_path[-1]
        # form polyline
        polyline = [mesh.face_centroid(fkey)for fkey in dual_path]
        polyline.insert(0, line0[0])
        polyline.append(line0[-1])
        zz.append(polyline)
    else:
        zz.append([line0[0], midpoint_point_point(*line0), line0[1]])

# tweak wound line
new_wound_lines = []
for i, line in enumerate(wound_lines):
    pl = [line[0]] + zz[i][1:-1] + [line[1]]
    new_wound_lines.append(pl)

zzz = [rs.AddPolyline(new_wound_lines[0])]
for pl in new_wound_lines[1:]:
    zzz = rs.JoinCurves(zzz + [rs.AddPolyline(pl)])
#zzz = [rs.AddPolyline(pl) for pl in zz]


wound_lines = new_wound_lines


### vertical offset at the nodes ###

points = {}
for vertex in vertices:
    gkey = geometric_key(vertex)
    if gkey not in points:
        points[gkey] = -1

offset_nb = []
for vertex in vertices:
    gkey = geometric_key(vertex)
    points[gkey] += 1
    offset_nb.append(points[gkey])

top_offset = max(offset_nb) + 1
offset_vect = [0.0, 0.0, v_offset]
offset_vertices = [add_vectors(vertex, scale_vector(offset_vect, offset_nb[i])) for i, vertex in enumerate(vertices)]

# differentiated vertical offset of the polyline lines and sublines

offset_wound_lines = []
for i, points in enumerate(wound_lines):
    a, f = points[0], points[-1]
    a1, f1 = points[1], points[-2]
    # create polylines (a, b, c, d, e, f) with three horizontal lines and two vertical lines like a crenel
    af = normalize_vector(subtract_vectors(f, a))
    af_start = scale_vector(af, h_offset)
    af_end = af_1 = scale_vector(af_start, -1)
    b = add_vectors(a, af_start)
    e = add_vectors(f, af_end)
    #if not is_point_in_box_xy(midpoint_point_point(a, f), xmin, xmax, ymin, ymax):
    #    local_top_offset = max(offset_nb[i], offset_nb[i + 1])
    #    c = add_vectors(b, scale_vector(offset_vect, local_top_offset))
    #    d = add_vectors(e, scale_vector(offset_vect, local_top_offset))
    c = add_vectors(b, scale_vector(offset_vect, top_offset))
    d = add_vectors(e, scale_vector(offset_vect, top_offset))
    a = add_vectors(a, scale_vector(offset_vect, offset_nb[i]))
    a0 = add_vectors(a, scale_vector(offset_vect, top_offset))
    b = add_vectors(b, scale_vector(offset_vect, offset_nb[i]))
    e = add_vectors(e, scale_vector(offset_vect, offset_nb[i + 1]))
    f = add_vectors(f, scale_vector(offset_vect, offset_nb[i + 1]))
    f0 = add_vectors(f, scale_vector(offset_vect, top_offset))
    straight_start, straight_end = is_path_straight[i], is_path_straight[i + 1]
    if not straight_start and not straight_end:
        offset_wound_lines.append([a, b, c, d, e, f])
    elif straight_start and not straight_end:
        offset_wound_lines.append([a0, d, e, f])
    elif not straight_start and straight_end:
        offset_wound_lines.append([a, b, c, f0])
    else:
        offset_wound_lines.append([a0, f0])

# complete total path with arc elements around nodes between lines

total_path = []

for i, vertex in enumerate(offset_vertices[1:-1]):
    prev_line, next_line = offset_wound_lines[i : i + 2]
    prev_pt, next_pt = prev_line[-1], next_line[0]
    
    # initial loop to lock
    if i == 0:
        a = prev_line[0]
        centre = [vertices[0][0], vertices[0][1], a[2]]
        direction = normalize_vector(subtract_vectors(prev_line[0], prev_line[1]))
        b = add_vectors(centre, scale_vector(direction, h_offset))
        c = add_vectors(centre, subtract_vectors(centre, a))
        total_path.append(rs.AddArc3Pt(a, c, b))
    
    total_path.append(rs.AddPolyline(prev_line))
    
    # connect with arcs
    if geometric_key(prev_pt) != geometric_key(next_pt):
        mid_pt = centroid_points([prev_pt, next_pt])
        prev_dir = normalize_vector(subtract_vectors(prev_line[-1], prev_line[-2]))
        next_dir = normalize_vector(subtract_vectors(next_line[1], next_line[0]))
        dir = normalize_vector(add_vectors(prev_dir, scale_vector(next_dir, -1)))
        arc_pt = add_vectors(scale_vector(dir, h_offset), vertex)
        total_path.append(rs.AddArc3Pt(prev_pt, next_pt, arc_pt))
    
    if i == len(offset_vertices[1:-1]) - 1:
        total_path.append(rs.AddPolyline(next_line))
        # final loop to lock
        a = next_line[-1]
        centre = [vertices[-1][0], vertices[-1][1], a[2]]
        direction = normalize_vector(subtract_vectors(next_line[-1], next_line[-2]))
        b = add_vectors(centre, scale_vector(direction, h_offset))
        c = add_vectors(centre, subtract_vectors(centre, a))
        total_path.append(rs.AddArc3Pt(a, c, b))
# ---------- end python_14 ----------
geo_4 = Geometry(python_14.zzz)
split = SplitList(List=geo_4, Index=Slider(30, range=0..100))  # -> ListA, ListB
panel_4 = Panel(python_14.out)
geo_5 = Geometry(python_14.total_path)

# ---- group: result summary
# filament length BEFORE eulerisation [m]
# filament length AFTER eulerisation [m]
# filament volume AFTER eulerisation [cm3]
# min number of passes AFTER eulerisation [-]
# max number of passes AFTER eulerisation [-]
# tool path length [m]
len_3 = Length(Curve=python_10.polyline)
len_4 = Length(Curve=python_5.bottom_reinf)
len_5 = Length(Curve=geo_5)
multiplication_6 = Multiplication(A=len_3, B=filament_cross_section_area_m2)
ma_3 = MassAddition(Input=len_4)  # -> Result, PartialResults
ma_4 = MassAddition(Input=len_5)  # -> Result, PartialResults
multiplication_7 = Multiplication(A=multiplication_6, B="1e6")
merge = Merge(
    Data1=flatten(ma_3.Result),
    Data2=flatten(len_3),
    Data3=flatten(multiplication_7),
    Data4=flatten(item_2),
    Data5=flatten(item),
    Data6=flatten(ma_4.Result))

# ----
lng = ListLength(List=geo_4)
geo_6 = Geometry(split.ListA)
lng_2 = ListLength(List=geo_6)
series = Series(Start=0, Step=1, Count=lng_2)
panel_5 = Panel("/Users/robinoval/Desktop/data.txt")

# ---- group: plot path
multiplication_8 = Multiplication(A=X, B="3")
move_6 = Move(Geometry=geo_5, Motion=multiplication_8)  # -> Geometry, Transform
explode_3 = Explode(Curve=move_6.Geometry, Recursive=True)  # -> flatten(Segments), Vertices
lng_3 = ListLength(List=move_6.Geometry)
curvepoint = PointOnCurve(explode_3.Segments, parameter=0.5)
pt_3 = Point(python.points)
series_2 = Series(Start=0, Step=1, Count=lng_3)
pdecon_2 = Deconstruct(Point=pt_3)  # -> XComponent, YComponent, ZComponent
gradient_2 = Gradient(
    LowerLimit=0,
    UpperLimit=lng_3,
    Parameter=series_2,
    stops=[0: RGB(234, 38, 0), 0.25: RGB(234, 126, 0), 0.5: RGB(254, 244, 84), 0.75: RGB(173, 203, 249), 1: RGB(75, 107, 169)])
pdecon_3 = Deconstruct(Point=curvepoint)  # -> XComponent, YComponent, ZComponent
pt_4 = ConstructPoint(XCoordinate=pdecon_2.XComponent, YCoordinate=pdecon_2.YComponent, ZCoordinate=0)
sort_2 = SortList(Keys=pdecon_3.ZComponent)  # -> Keys, ValuesA
duppt = RemoveDuplicatePts(Points=pt_4, Tolerance=0.01)
item_4 = ListItem(List=reverse(sort_2.Keys), Index=0, Wrap=True)
item_5 = ListItem(List=sort_2.Keys, Index=0, Wrap=True)
preview_5 = CustomPreview(Geometry=move_6.Geometry, Material=gradient_2)
cyl = Cylinder(Base=duppt, Radius=Slider(0.01, range=0..0.01), Length=Slider(0.1, range=0..0.1))
gradient_3 = Gradient(
    LowerLimit=item_5,
    UpperLimit=item_4,
    Parameter=pdecon_3.ZComponent,
    stops=[0: RGB(234, 38, 0), 0.25: RGB(234, 126, 0), 0.5: RGB(254, 244, 84), 0.75: RGB(173, 203, 249), 1: RGB(75, 107, 169)])
cap = CapHoles(Brep=cyl)
move_7 = Move(Geometry=cap, Motion=multiplication_8)  # -> Geometry, Transform
preview_6 = CustomPreview(Geometry=move_7.Geometry, Material=ColourSwatch(SwatchColor=RGB(127, 127, 127)))
preview_7 = CustomPreview(Geometry=explode_3.Segments, Material=gradient_3)

# ----
join = JoinCurves(Curves=geo_5, Preserve=False)
panel_6 = Panel(merge)
crv = Curve(join)
gradient_4 = Gradient(LowerLimit="0", UpperLimit=lng, Parameter=series, stops=[0: RGB(0, 128, 0), 0.5: RGB(255, 255, 0), 1: RGB(255, 0, 0)])
# write and read json of curve
# made of lines and arcs
python_15 = GhPythonScript(curve=crv, filepath=panel_5, save=Toggle(False))  # -> out
# ---------- python_15: Python ----------
import json
import rhinoscriptsyntax as rs

if save:
    data = []
    for crv in rs.ExplodeCurves(curve):
        pts = [rs.CurveStartPoint(crv), rs.CurveEndPoint(crv)]
        if rs.IsArc(crv):
            pts.append(rs.CurveMidPoint(crv))
        data.append([[x, y, z] for x, y, z in pts])

    with open(filepath, 'w') as outfile:
        json.dump(data, outfile)
# ---------- end python_15 ----------
python_16 = GhPythonScript(update=Button(), filepath=panel_5)  # -> out, curve; disabled
# ---------- python_16: Python ----------
import json
from copy import deepcopy
import rhinoscriptsyntax as rs

if update:
    pass



with open(filepath) as json_file:
    data = json.load(json_file)
    curves = []
    for pts in data:
        if len(pts) == 2:
            func = rs.AddLine
        elif len(pts) == 3:
            func = rs.AddArc3Pt
        curves.append(func(*pts))
    curve = rs.JoinCurves(curves, tolerance=1e-6)
# ---------- end python_16 ----------
preview_8 = CustomPreview(Geometry=geo_6, Material=gradient_4)
crv_2 = Curve(python_16.curve)
python_17 = GhPythonScript(curves=move_6.Geometry)  # -> out, curve; inputs curves: list
# ---------- python_17: Python ----------
__author__ = "robinoval"

import rhinoscriptsyntax as rs

curve = curves[:1]
for crv in curves[1:]:
    curve = rs.JoinCurves(curve + [crv])
# ---------- end python_17 ----------

topoly = CurveToPolyline(Curve=crv, ToleranceDistance="0.001", ToleranceAngle=0)  # -> Polyline, Segments
explode_4 = Explode(Curve=topoly.Polyline, Recursive=True)  # -> Segments, Vertices
split_2 = SplitList(List=reverse(explode_4.Vertices), Index=1)  # -> ListA, reverse(ListB)
shift = ShiftList(List=explode_4.Vertices, Shift=1, Wrap=False)
vec2pt = Vector2Pt(PointA=split_2.ListB, PointB=shift, Unitize=False)  # -> Vector, Length
Z = UnitZ(Factor=1)
pi = Pi(Factor="1/4")
xprod = CrossProduct(VectorA=vec2pt.Vector, VectorB=Z, Unitize=True)  # -> Vector, Length
rot3d = Rotate3D(Geometry=vec2pt.Vector, Angle=pi, Center=Point(0, 0, 0), Axis=xprod.Vector)  # -> Geometry, Transform
multiplication_9 = Multiplication(A=rot3d.Geometry, B=".2")
vdis_3 = VectorDisplay(Anchor=split_2.ListB, Vector=multiplication_9)

pipe_2 = Pipe(Curve=move_6.Geometry, Radius=Slider(0.001, range=0..0.01), Caps=2)  # -> flatten(Pipe); disabled
