# Grasshopper definition reinforcement_plate.gh (Grasshopper 1.0.7)
# plug-ins: Kangaroo2 Components

lx_m = Slider(6, range=0..10)
ly_m = Slider(6, range=0..10)
lz_m = Slider(0.15, range=0..10)
nx = Slider(5, range=0..50)
ny = Slider(5, range=0..20)
nz = Slider(1, range=0..10)
init_dist_m = Slider(2, range=0..5)
max_dist_m = Slider(2, range=0..5)
surface_load_kn_m = Slider(5, range=0..100)
filament_cross_section_area_mm2 = Slider(1.93, range=0..10)
number_filament = Slider(10, range=1..10)
filament_tensile_strength_mpa = Slider(4000, range=0..10000)
concrete_compressive_strength_mpa = Slider(30, range=0..100)
force_threshold_kn = Panel("1e-6")
division = Division(A=filament_cross_section_area_mm2, B=1000000)

# ---- group: PROBLEM DEFINITION
python = GhPythonScript(
    lx=lx_m,
    ly=ly_m,
    lz=lz_m,
    nx=nx,
    ny=ny,
    nz=nz,
    init_dist=init_dist_m,
    max_dist=max_dist_m,
    surface_load=surface_load_kn_m)  # -> out, points, lines, mesh, start_idx, end_idx, supports, loads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; inputs nx: Int32, ny: Int32, nz: Int32
# ---------- python: Python ----------
import rhinoscriptsyntax as rs
import itertools as it
from compas.datastructures import Network, Mesh
from compas.geometry import distance_point_point

def filter_lines(u_xyz, v_xyz):
    ux, uy, uz = u_xyz
    vx, vy, vz = v_xyz
    if uy == vy and uz == vz and distance_point_point(u_xyz, v_xyz) > lx / nx + 1e-6:
        return False
    if ux == vx and uz == vz and distance_point_point(u_xyz, v_xyz) > ly / ny + 1e-6:
        return False
    return True

# geometry

nodes = [[x * lx / max(1, nx), y * ly / max(1, ny), z * lz / max(1, nz)] for x, y, z in it.product(range(nx + 1), range(ny + 1), range(nz + 1))]
edges = [(u, v) for u, v in it.combinations(range(len(nodes)), 2) if distance_point_point(nodes[u], nodes[v]) < max_dist]
ntk = Network.from_nodes_and_edges(nodes, edges)

mesh = rs.AddMesh(*Mesh.from_meshgrid(lx, nx, ly, ny).to_vertices_and_faces())

points = [rs.AddPoint(ntk.node_coordinates(key)) for key in ntk.nodes()]

lines = []
for u, v in ntk.edges():
    ux, uy, uz = ntk.node_coordinates(u)
    vx, vy, vz = ntk.node_coordinates(v)
    lines.append(rs.AddLine([ux, uy, uz], [vx, vy, vz]))

# statics system

p = surface_load * lx / nx * ly / ny # load per unit square
loads = []
supports = []
for key in ntk.nodes():
    x, y, z = ntk.node_coordinates(key)
    
    if ((abs(x) < 1e-6 and abs(y) < 1e-6) or (abs(x) < 1e-6 and abs(y - ly) < 1e-6) or (abs(x - lx) < 1e-6 and abs(y) < 1e-6) or (abs(x - lx) < 1e-6 and abs(y - ly) < 1e-6)) and z == 0:
        supports.append(rs.AddPoint([1, 1, 0]))
    else:
        supports.append(rs.AddPoint([1, 1, 1]))
    
    if abs(z - lz) < 1e-6:
        if (abs(x) < 1e-6 or abs(x - lx) < 1e-6) and (abs(y) < 1e-6 or abs(y - ly) < 1e-6):
            loads.append(rs.AddPoint([0.0, 0.0, -p/4]))
        elif abs(x) < 1e-6 or abs(x - lx) < 1e-6 or abs(y) < 1e-6 or abs(y - ly) < 1e-6:
            loads.append(rs.AddPoint([0.0, 0.0, -p/2]))
        else:
            loads.append(rs.AddPoint([0.0, 0.0, -p]))
    else:
        loads.append(rs.AddPoint([0.0, 0.0, 0.0]))

# line attributes

start_idx, end_idx = [], [] # extremity vertices
init_set = [] # is line include in initial set for optimisation
comp_str = [] # compressive strength
tens_str = [] # tensile strength
for u, v in ntk.edges():
    ux, uy, uz = ntk.node_coordinates(u)
    vx, vy, vz = ntk.node_coordinates(v)
    if filter_lines(ntk.node_coordinates(u), ntk.node_coordinates(v)):
        start_idx.append(u)
        end_idx.append(v)
        if ntk.edge_length((u, v)) < init_dist:
            init_set.append(True)
        else:
            init_set.append(False)
        comp_str.append(1.0)
        if uz == vz or (ux == vx and uy == vy):
            tens_str.append(1.0)
        else:
            tens_str.append(0.0)
# ---------- end python ----------

# ---- group: plot ground structure, supports, and loads
rev = Reverse(Vector=python.supports)
vec = VectorXYZ(XComponent="1", YComponent="1", ZComponent="1")  # -> Vector, Length
multiplication = Multiplication(A=python.loads, B="0.1")
addition = Addition(A=vec.Vector, B=rev)
line = Line(python.lines)
rev_2 = Reverse(Vector=multiplication)
len = Length(Curve=line)
multiplication_2 = Multiplication(A=addition, B=Slider(0.1, range=0..0.1))
smaller = SmallerThan(FirstNumber=len, SecondNumber=max_dist_m)  # -> SmallerThan, OrEqualTo
rev_3 = Reverse(Vector=multiplication_2)
dispatch = Dispatch(List=line, DispatchPattern=smaller.SmallerThan)  # -> ListA, ListB
move = Move(Geometry=python.points, Motion=rev_2)  # -> Geometry, Transform
move_2 = Move(Geometry=python.points, Motion=rev_3)  # -> Geometry, Transform
preview = CustomPreview(Geometry=line, Material=ColourSwatch(SwatchColor=RGB(127, 127, 127)))
vdis = VectorDisplay(Anchor=move.Geometry, Vector=multiplication)
vdis_2 = VectorDisplay(Anchor=move_2.Geometry, Vector=multiplication_2)

# ----
multiplication_3 = Multiplication(A=division, B=number_filament)

# ---- group: LAYOUT OPTIMISATION
python_2 = GhPythonScript(
    points=python.points,
    supports=python.supports,
    loads=python.loads,
    start_point_indices=python.start_idx,
    end_point_indices=python.end_idx,
    compressive_strengths=python.comp_str,
    tensile_strengths=python.tens_str,
    in_initial_set=python.init_set,
    threshold=-1)  # -> out, lines, sections, forces; inputs points: list, supports: list, loads: list, start_point_indices: list of Int32, end_point_indices: list of Int32, compressive_strengths: list, tensile_strengths: list, in_initial_set: list of Boolean
# ---------- python_2: Python ----------
import rhinoscriptsyntax as rs
import itertools as it
from compas.rpc import Proxy
import acorn_reinforcement

proxy = Proxy("acorn_reinforcement.optimisation")
proxy.restart_server()
lo2 = proxy.lo2

nodes = [([xyz for xyz in rs.PointCoordinates(point)], [xyz for xyz in rs.PointCoordinates(support)], [xyz for xyz in rs.PointCoordinates(load)]) for point, support, load in zip(points, supports, loads)]
lines = [(i, j, cs, ts, include) for i, j, cs, ts, include in zip(start_point_indices, end_point_indices, compressive_strengths, tensile_strengths, in_initial_set)]

Nd, Cn, a, q = lo2(nodes, lines, joint_cost=.0001)

lines = [rs.AddLine(Nd[int(cn[0])], Nd[int(cn[1])]) for i, cn in enumerate(Cn) if a[i] > threshold]
sections = [ai for ai in a if ai > threshold]
forces = [qi for i, qi in enumerate(q[0]) if a[i] > threshold]
# ---------- end python_2 ----------

# ---- group: plot struts and ties
python_3 = GhPythonScript(
    lines=python_2.lines,
    sections=python_2.sections,
    forces=python_2.forces,
    strength_comp=concrete_compressive_strength_mpa,
    strength_tens=filament_tensile_strength_mpa,
    threshold=force_threshold_kn)  # -> out, struts, ties; inputs lines: list, sections: list, forces: list
# ---------- python_3: Python ----------
import rhinoscriptsyntax as rs
from math import pi

# get compressive struts and tensile ties

struts, ties = [], []
for line, section, force in zip(lines, sections, forces):
    if abs(force) > threshold:
        strength = strength_tens if force > 0 else strength_comp
        pipe = rs.AddPipe(line, 0, (abs(force) / 1000 / strength / pi) ** .5, blend_type=1, cap=1, fit=False)
        if force > 0:
            ties += pipe
        else:
            struts += pipe
# ---------- end python_3 ----------
multiplication_4 = Multiplication(A=ly_m, B="1.5")
X = UnitX(Factor=multiplication_4)
move_3 = Move(Geometry=python_3.ties, Motion=X)  # -> Geometry, Transform
move_4 = Move(Geometry=python_3.struts, Motion=X)  # -> Geometry, Transform
preview_2 = CustomPreview(Geometry=move_4.Geometry, Material=ColourSwatch(SwatchColor=RGB(0, 0, 255)))
preview_3 = CustomPreview(Geometry=move_3.Geometry, Material=ColourSwatch(SwatchColor=RGB(255, 0, 0)))

# ---- group: PASS SIZING
python_4 = GhPythonScript(
    lines=python_2.lines,
    forces=python_2.forces,
    zmin=0,
    zmax=lz_m,
    fil_str=filament_tensile_strength_mpa,
    fil_sec=multiplication_3,
    threshold=force_threshold_kn)  # -> out, bottom_reinf, top_reinf, all_bottom_lines, all_top_lines; inputs lines: list, forces: list
# ---------- python_4: Python ----------
import rhinoscriptsyntax as rs
from math import ceil

# get the reinforcement at the top and the bottom surfaces
# sized by filament strength in MPa and cross-section in m2

bottom_reinf, top_reinf = [], []
all_bottom_lines, all_top_lines = [], []
for line, force in zip(lines, forces):
    ax, ay, az = rs.CurveStartPoint(line)
    bx, by, bz = rs.CurveEndPoint(line)
    if force > threshold:
        n = int(ceil(force / (fil_str * fil_sec * 1000)))
        if az == zmin and bz == zmin:
            bottom_reinf += [line] * n
        elif az == zmax and bz == zmax:
            top_reinf += [line] * n
    if az == zmin and bz == zmin:
        all_bottom_lines.append(line)
    elif az == zmax and bz == zmax:
        all_top_lines.append(line)
# ---------- end python_4 ----------

# ---- group: GRAPH EULERISATION
python_5 = GhPythonScript(required_lines=python_4.bottom_reinf, optional_lines=python_4.all_bottom_lines, split_points=python.points)  # -> out, polyline; inputs required_lines: list, optional_lines: list, split_points: list
# ---------- python_5: Python ----------
import rhinoscriptsyntax as rs
import itertools as it
from compas.rpc import Proxy
import acorn_reinforcement
from compas.tolerance import Tolerance
from compas.utilities import pairwise
from compas.geometry import is_point_on_segment, distance_point_point

def split_lines(lines, split_points):
    lines = [(rs.CurveStartPoint(line), rs.CurveEndPoint(line)) for line in lines]
    split_lines = []
    for line in lines:
        splits = {}
        for pt in split_points:
            xyz = rs.PointCoordinates(pt)
            if is_point_on_segment(xyz, line):
                splits[tuple(xyz)] = distance_point_point(xyz, line[0])
        split_lines += [(a[0], b[0]) for a, b in pairwise(sorted(splits.items(), key=lambda item: item[1]))]
    return [rs.AddLine(*line) for line in split_lines]

# eulerisation to find a continuous through the lines

proxy = Proxy("acorn_reinforcement.eulerisation")
rpp = proxy.rpp

required_lines = required_lines or []
optional_lines = optional_lines or []

required_lines = split_lines(required_lines, split_points)
optional_lines = split_lines(optional_lines, split_points)

tol = Tolerance()
geometric_key = tol.geometric_key

count = 0
geom_keys = {}
for line in required_lines + optional_lines:
    for point in (rs.CurveStartPoint(line), rs.CurveEndPoint(line)):
        point = [xyz for xyz in point]
        if geometric_key(point) not in geom_keys:
            geom_keys[geometric_key(point)] = (point, count)
            count += 1

key_to_xyz ={key: xyz for xyz, key in geom_keys.values()} 

required_lines = [(geom_keys[geometric_key(rs.CurveStartPoint(line))][1], geom_keys[geometric_key(rs.CurveEndPoint(line))][1]) for line in required_lines]
optional_lines = [(geom_keys[geometric_key(rs.CurveStartPoint(line))][1], geom_keys[geometric_key(rs.CurveEndPoint(line))][1]) for line in optional_lines]

edges = rpp(required_lines, optional_lines, key_to_xyz)

if len(edges) != 0:
    polyline = rs.AddPolyline([key_to_xyz[edges[0][0]]] + [key_to_xyz[edge[1]] for edge in edges])
else:
    polyline = None
# ---------- end python_5 ----------

# ---- group: plot passes
python_6 = GhPythonScript(polyline=python_5.polyline)  # -> out, unique_lines, counts; inputs polyline: list
# ---------- python_6: Python ----------
import rhinoscriptsyntax as rs
from compas.tolerance import Tolerance
from compas.utilities import reverse_geometric_key

tol = Tolerance()
geometric_key = tol.geometric_key

# count passes per line

lines = rs.ExplodeCurves(polyline)

line_count = {}
for line in lines:
    u_gk = geometric_key(rs.CurveStartPoint(line))
    v_gk = geometric_key(rs.CurveEndPoint(line))
    if (u_gk, v_gk) in line_count:
        line_count[(u_gk, v_gk)] += 1
    elif (v_gk, u_gk) in line_count:
        line_count[(v_gk, u_gk)] += 1
    else:
        line_count[(u_gk, v_gk)] = 1

unique_lines = []
counts = []
for (u_gk, v_gk), count in line_count.items():
    u_xyz = reverse_geometric_key(u_gk)
    v_xyz = reverse_geometric_key(v_gk)
    unique_lines.append(rs.AddLine(u_xyz, v_xyz))
    counts.append(count)
# ---------- end python_6 ----------
sort = SortList(Keys=python_6.counts)  # -> Keys, ValuesA
item = ListItem(List=reverse(sort.Keys), Index=0, Wrap=True)
item_2 = ListItem(List=sort.Keys, Index=0, Wrap=True)
gradient = Gradient(
    LowerLimit=item_2,
    UpperLimit=item,
    Parameter=python_6.counts,
    stops=[0: RGB(0, 128, 0), 0.5: RGB(255, 255, 0), 1: RGB(255, 0, 0)])
multiplication_5 = Multiplication(A=python_6.counts, B=Slider(0.002, range=0..0.01))
multiplication_6 = Multiplication(A=X, B="2")
move_5 = Move(Geometry=python_6.unique_lines, Motion=multiplication_6)  # -> Geometry, Transform
pipe = Pipe(Curve=move_5.Geometry, Radius=multiplication_5, Caps=2)  # -> flatten(Pipe)
preview_4 = CustomPreview(Geometry=pipe, Material=gradient)

# ----
v_offset_m = Slider(0.01, range=0..1)
lx = Expression(lx=lx_m, nx=nx, k="3", Expression="lx / nx / k")

# ---- group: PATH WINDING
python_7 = GhPythonScript(polyline=python_5.polyline, mesh=python.mesh, h_offset=lx, v_offset=v_offset_m)  # -> out, total_path
# ---------- python_7: Python ----------
from math import pi
import rhinoscriptsyntax as rs
from acorn_reinforcement.winding import wind_polyline
from compas.datastructures import Mesh, Network
from compas.tolerance import Tolerance
from compas.utilities import pairwise, window
from compas.geometry import length_vector, add_vectors, subtract_vectors, scale_vector, normalize_vector, centroid_points, centroid_points_weighted, angle_points, angle_vectors, cross_vectors, dot_vectors, rotate_points, distance_point_point, midpoint_point_point, intersection_segment_segment

tol = Tolerance()
geometric_key = tol.geometric_key

### horizontal offset of the polyline ###

vertices = rs.PolylineVertices(polyline)
mesh = Mesh.from_vertices_and_faces(rs.MeshVertices(mesh), rs.MeshFaceVertices(mesh))
geomap = {geometric_key(mesh.vertex_coordinates(vkey)): vkey for vkey in mesh.vertices()}

wound_lines = wind_polyline(vertices, h_offset)

# mark if path is straight to simplify path later
is_path_straight = [False] + [b == c for (a, b), (c, d) in pairwise(wound_lines)] + [False]

segment = []
for line0 in pairwise(vertices):
    # get intersections with edges
    edges = []
    dual_edges = []
    for u, v in mesh.edges():
        line = mesh.edge_coordinates((u, v))
        i = intersection_segment_segment(line0, line)
        if i != (None, None):
            if distance_point_point(i[0], line[0]) > 1e-6 and distance_point_point(i[0], line[1]) > 1e-6:
                if not mesh.is_edge_on_boundary((u, v)):
                    f0, f1 = mesh.halfedge[u][v], mesh.halfedge[v][u]
                    edges.append((u, v))
                    dual_edges.append((f0, f1))

    # create polyline
    dual_lines = [rs.AddLine(mesh.face_centroid(f0), mesh.face_centroid(f1)) for f0, f1 in dual_edges]
    dual_nodes = [mesh.face_centroid(fkey) for fkey in mesh.faces()]
    nwk = Network.from_nodes_and_edges(dual_nodes, dual_edges)
    extremities = [node for node in nwk.nodes() if nwk.is_leaf(node)]
    if len(extremities) == 2:
        dual_path = nwk.shortest_path(*extremities)
        # check orientation
        if distance_point_point(mesh.face_centroid(dual_path[0]), line0[0]) > distance_point_point(mesh.face_centroid(dual_path[0]), line0[-1]):
            dual_path.reverse()
        # check relevance of first edge
        if geomap[geometric_key(line0[0])] in mesh.face_vertices(dual_path[1]):
            del dual_path[0]
        # check relevance of last edge
        if geomap[geometric_key(line0[-1] )]in mesh.face_vertices(dual_path[-2]):
            del dual_path[-1]
        # form polyline
        polyline = [mesh.face_centroid(fkey)for fkey in dual_path]
        polyline.insert(0, line0[0])
        polyline.append(line0[-1])
        segment.append(polyline)
    else:
        segment.append([line0[0], midpoint_point_point(*line0), line0[1]])

# tweak wound line
new_wound_lines = []
for i, line in enumerate(wound_lines):
    pl = [line[0]] + segment[i][1:-1] + [line[1]]
    new_wound_lines.append(pl)
wound_lines = new_wound_lines

### vertical offset at the nodes ###

points = {}
for vertex in vertices:
    gkey = geometric_key(vertex)
    if gkey not in points:
        points[gkey] = -1

offset_nb = []
for vertex in vertices:
    gkey = geometric_key(vertex)
    points[gkey] += 1
    offset_nb.append(points[gkey])

top_offset = max(offset_nb) + 1
offset_vect = [0.0, 0.0, v_offset]
offset_vertices = [add_vectors(vertex, scale_vector(offset_vect, offset_nb[i])) for i, vertex in enumerate(vertices)]

# differentiated vertical offset of the polyline lines and sublines

offset_wound_lines = []
for i, points in enumerate(wound_lines):
    a, f = points[0], points[-1]
    a1, f1 = points[1], points[-2]
    af = normalize_vector(subtract_vectors(f, a))
    af_start = scale_vector(af, h_offset)
    af_end = af_1 = scale_vector(af_start, -1)
    b = add_vectors(a, af_start)
    e = add_vectors(f, af_end)
    c = add_vectors(b, scale_vector(offset_vect, top_offset))
    d = add_vectors(e, scale_vector(offset_vect, top_offset))
    a = add_vectors(a, scale_vector(offset_vect, offset_nb[i]))
    a0 = add_vectors(a, scale_vector(offset_vect, top_offset))
    b = add_vectors(b, scale_vector(offset_vect, offset_nb[i]))
    e = add_vectors(e, scale_vector(offset_vect, offset_nb[i + 1]))
    f = add_vectors(f, scale_vector(offset_vect, offset_nb[i + 1]))
    f0 = add_vectors(f, scale_vector(offset_vect, top_offset))
    straight_start, straight_end = is_path_straight[i], is_path_straight[i + 1]
    if not straight_start and not straight_end:
        offset_wound_lines.append([a, b, c, d, e, f])
    elif straight_start and not straight_end:
        offset_wound_lines.append([a0, d, e, f])
    elif not straight_start and straight_end:
        offset_wound_lines.append([a, b, c, f0])
    else:
        offset_wound_lines.append([a0, f0])

# complete total path with arc elements around nodes between lines

total_path = []

for i, vertex in enumerate(offset_vertices[1:-1]):
    prev_line, next_line = offset_wound_lines[i : i + 2]
    prev_pt, next_pt = prev_line[-1], next_line[0]
    
    # initial loop to lock
    if i == 0:
        a = prev_line[0]
        centre = [vertices[0][0], vertices[0][1], a[2]]
        direction = normalize_vector(subtract_vectors(prev_line[0], prev_line[1]))
        b = add_vectors(centre, scale_vector(direction, h_offset))
        c = add_vectors(centre, subtract_vectors(centre, a))
        total_path.append(rs.AddArc3Pt(a, c, b))
    
    total_path.append(rs.AddPolyline(prev_line))
    
    # connect with arcs
    if geometric_key(prev_pt) != geometric_key(next_pt):
        mid_pt = centroid_points([prev_pt, next_pt])
        prev_dir = normalize_vector(subtract_vectors(prev_line[-1], prev_line[-2]))
        next_dir = normalize_vector(subtract_vectors(next_line[1], next_line[0]))
        dir = normalize_vector(add_vectors(prev_dir, scale_vector(next_dir, -1)))
        arc_pt = add_vectors(scale_vector(dir, h_offset), vertex)
        total_path.append(rs.AddArc3Pt(prev_pt, next_pt, arc_pt))
    
    if i == len(offset_vertices[1:-1]) - 1:
        total_path.append(rs.AddPolyline(next_line))
        # final loop to lock
        a = next_line[-1]
        centre = [vertices[-1][0], vertices[-1][1], a[2]]
        direction = normalize_vector(subtract_vectors(next_line[-1], next_line[-2]))
        b = add_vectors(centre, scale_vector(direction, h_offset))
        c = add_vectors(centre, subtract_vectors(centre, a))
        total_path.append(rs.AddArc3Pt(a, c, b))
# ---------- end python_7 ----------

# ----
geo = Geometry(python_7.total_path)

# ---- group: plot path
multiplication_7 = Multiplication(A=X, B="3")
move_6 = Move(Geometry=geo, Motion=multiplication_7)  # -> Geometry, Transform
lng = ListLength(List=move_6.Geometry)
pt = Point(python.points)
series = Series(Start=0, Step=1, Count=lng)
pdecon = Deconstruct(Point=pt)  # -> XComponent, YComponent, ZComponent
gradient_2 = Gradient(
    LowerLimit=0,
    UpperLimit=lng,
    Parameter=series,
    stops=[0: RGB(234, 38, 0), 0.25: RGB(234, 126, 0), 0.5: RGB(254, 244, 84), 0.75: RGB(173, 203, 249), 1: RGB(75, 107, 169)])
pt_2 = ConstructPoint(XCoordinate=pdecon.XComponent, YCoordinate=pdecon.YComponent, ZCoordinate=0)
duppt = RemoveDuplicatePts(Points=pt_2, Tolerance=0.01)
cyl = Cylinder(Base=duppt, Radius=Slider(0.01, range=0..0.01), Length=Slider(0.1, range=0..0.1))
cap = CapHoles(Brep=cyl)
move_7 = Move(Geometry=cap, Motion=multiplication_7)  # -> Geometry, Transform
preview_5 = CustomPreview(Geometry=move_7.Geometry, Material=ColourSwatch(SwatchColor=RGB(127, 127, 127)))
preview_6 = CustomPreview(Geometry=move_6.Geometry, Material=gradient_2)

# ----
pipe_2 = Pipe(Curve=move_6.Geometry, Radius=Slider(0.005, range=0..0.1), Caps=2)  # -> flatten(Pipe); disabled
